% Simulink data dictionary MotorVeneta.sldd

Ra = 1.5
Jm = 5.18e-6
ki = 0.046
kb = 0.0191
tau = 0.008843615
K = 52.35602
G1a = tf(num={[0 52.35602]}, den={[0.008843615 1]}, Ts=0, Name="G1a")
den1 = [0.008843615 1]
num1 = 52.35602
FLAG = false
Kp = 2000
Gl = tf(num={[0 104712]}, den={[0.008843615 1]}, Ts=0, Name="Gl")
Glc = tf(num={[0 104712]}, den={[0.008843615 104713]}, Ts=0, Name="Glc")
Gpi = tf(num={[0 209424.1]}, den={[0.008843615 209425.1]}, Ts=0, Name="Gpi")